# Grasshopper definition 1240.gh (Grasshopper 0.9.76)

crv = Curve(graft([<curve referenced from the Rhino model> x35]))
pt = Point(<point referenced from the Rhino model>)
crv_2 = Curve(graft([<curve referenced from the Rhino model> x13]))
crv_3 = Curve(<curve referenced from the Rhino model>)
crv_4 = Curve(<curve referenced from the Rhino model>)
crv_5 = Curve(<curve referenced from the Rhino model>)
crv_cp = CurveClosestPoint(Point=pt, Curve=reparameterize(crv_3))  # -> Point, Parameter, Distance
ccx = CurveCurve(CurveA=crv_4, CurveB=crv)  # -> simplify(Points), ParamsA, ParamsB
ccx_2 = CurveCurve(CurveA=crv_5, CurveB=crv_2)  # -> simplify(Points), ParamsA, ParamsB
null = NullItem(Item=ccx.Points)  # -> simplify(NullFlags), InvalidFlags, Description
null_2 = NullItem(Item=ccx_2.Points)  # -> simplify(NullFlags), InvalidFlags, Description
panel = Panel(crv_cp.Parameter)
dispatch = Dispatch(List=crv, DispatchPattern=null.NullFlags)  # -> ListA, ListB
dispatch_2 = Dispatch(List=crv_2, DispatchPattern=null_2.NullFlags)  # -> ListA, ListB
crv_6 = Curve(dispatch.ListB)
crv_7 = Curve(dispatch_2.ListB)
flatten = FlattenTree(Tree=ccx.ParamsA, Path="{0}")
flatten_2 = FlattenTree(Tree=crv_6, Path="{0}")
flatten_3 = FlattenTree(Tree=ccx_2.ParamsA, Path="{0}")
flatten_4 = FlattenTree(Tree=crv_7, Path="{0}")
sort = SortList(Keys=flatten, ValuesA=flatten_2)  # -> Keys, ValuesA
sort_2 = SortList(Keys=flatten_3, ValuesA=flatten_4)  # -> Keys, ValuesA
N = Step(-1)
lng = ListLength(List=sort.ValuesA)
lng_2 = ListLength(List=sort_2.ValuesA)
series = Series(Start=0, Step=1, Count=lng)
series_2 = Series(Start=0, Step=N, Count=lng_2)
panel_2 = Panel(N)
panel_3 = Panel(series)
panel_4 = Panel(series_2)
pt_2 = ConstructPoint(XCoordinate=0, YCoordinate=0, ZCoordinate=series)
pt_3 = ConstructPoint(XCoordinate=0, YCoordinate=0, ZCoordinate=series_2)
xy = XYPlane(Origin=pt_2)
xy_2 = XYPlane(Origin=pt_3)
project = Project(Geometry=sort.ValuesA, Plane=xy)  # -> Geometry, Transform
project_2 = Project(Geometry=sort_2.ValuesA, Plane=xy_2)  # -> Geometry, Transform
flatten_5 = FlattenTree(Tree=[project.Geometry, project_2.Geometry], Path="{0}")
explode = Explode(Curve=flatten_5, Recursive=True)  # -> Segments, Vertices
flatten_6 = FlattenTree(Tree=explode.Vertices, Path="{0}")
del = DelaunayMesh(Points=flatten_6, Plane=PlaneXY(0, 0, 0))
